# Grasshopper definition GHCitySim.ghx (Grasshopper 0.9.76)
# plug-ins: Python Interpreter

# ----
# 0. Set inital parameters...
# You can download CitySim solver from
# http://citysim.epfl.ch
# ... and let the bees and bugs fly
name_of_the_simulation = Panel("test")
# GH-CitySim: an interface to CitySim started by Giuseppe Peronato
# 
# © All rights reserved. Ecole polytechnique fédérale de Lausanne (EPFL), Switzerland,
# Interdisciplinary Laboratory of Performance-Integrated Design (LIPID), 2016-2017
# Developer: Giuseppe Peronato <giuseppe.peronato@epfl.ch>
# 
# CitySim is a software developed and distributed by the
# Laboratory of Solar Energy and Building Physics (LESO-PB)
# http://citysim.epfl.ch/
# 
# Contributors:
# Aymeric Delmas <aymeric.delmas@imageen.re>
# 
# This tool relies on and will hopefully be part of
# Ladybug and Honeybee: two plugins for Environmental Analysis (GPL)
# started by Mostapha Sadeghipour Roudsari
select_your_path = Panel("C:\Users\peronato\Desktop\CitySimGH\")
path_to_citysim_solver = Panel("C:\CitySim.exe")
path_to_weather_file_epw = Panel("C:\Users\peronato\Documents\WeatherFiles\Neuchatel-hour.epw")
honeybee = Honeybee_Honeybee()  # -> Vviiiiiiiiiizzz; plug-in component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
ladybug = Ladybug_Ladybug()  # -> Vviiiiiiiiiizzz; plug-in component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
path = FilePath(select_your_path)
solver_path = Text(path_to_citysim_solver)
name = Text(name_of_the_simulation)
epw_path = FilePath(path_to_weather_file_epw)

# ----
# 1. Import Geometry
# In order to ceate HoneyBee zones, make sure you use closed breps only.
# Warning: Brep 2 is not closed because of the overhangs.
# You can simulate it only using the alternative workflow for solar radiation wiithout HoneyBee.
select_breps_to_simulate = Panel("""0
1""")
brep = Brep([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])
item = ListItem(List=brep, Index=select_breps_to_simulate, Wrap=True)
brep_2 = Brep(item)
panel = Panel(brep_2)
panel_2 = Panel(brep)

# ----
# Developer only
toggle = BooleanToggle(False)
exportladybug = Ladybug_ExportLadybug(components="*", targetFolder="C:\Users\peronato\Documents\GitHub\GHCitySim", export=toggle)  # -> readMe; plug-in component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

number_slider = Slider(80, range=0..100)
brep_3 = Brep(brep_2)
separatebynormal = Honeybee_SeparateByNormal(geometry=brep_3, maxUpDecAngle=number_slider, maxDownDecAngle=number_slider)  # -> simplify(lookingUp), simplify(lookingDown), simplify(lookingSide); plug-in component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
epopaquemat = Honeybee_EnergyPlusOpaqueMaterial(
    name="SIA380_insulation_ground",
    thickness=Slider(0.14, range=0..1),
    conductivity=Slider(0.036, range=0..0.1),
    density=Slider(35, range=0..100),
    specificHeat=Slider(1450, range=0..10000),
    solAbsp=Slider(0.8, range=0..1))  # -> EPMaterial; plug-in component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
epopaquemat_2 = Honeybee_EnergyPlusOpaqueMaterial(
    name="SIA380_insulation_exposed",
    thickness=Slider(0.21, range=0..1),
    conductivity=Slider(0.036, range=0..0.1),
    density=Slider(35, range=0..100),
    specificHeat=Slider(1450, range=0..10000),
    solAbsp=Slider(0.8, range=0..1))  # -> EPMaterial; plug-in component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
epopaquemat_3 = Honeybee_EnergyPlusOpaqueMaterial(
    name="wall_mass",
    thickness=Slider(0.2, range=0..1),
    conductivity=Slider(1.95, range=0..10),
    density=Slider(2240, range=0..10000),
    specificHeat=Slider(900, range=0..1000))  # -> EPMaterial; plug-in component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
number_slider_2 = Slider(10, range=0..10)
lng = ListLength(List=brep_3)
# Create HoneyBee zones
panel_3 = Panel("Swiss_ground")
series = Series(Start=0, Step=1, Count=lng)

# ----
# 2. Set Weather File
toggle_2 = BooleanToggle(False)
epw_path_2 = FilePath(epw_path)
path_2 = FilePath(path)
epw_to_clim = Ladybug_EpwToClim(epwFile=epw_path_2, path=path_2, Run=toggle_2)  # -> out, climatefile; plug-in component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
climate_file = Text(epw_to_clim.climatefile)

custom_mesh_settings = SettingsCustom(
    StitchSeams=True,
    SimplePlanes=False,
    Refine=True,
    MinCount=0,
    MaxCount=0,
    AspectRatio=20,
    MaxDistance=0,
    MaxAngle=20,
    MinEdge=number_slider_2,
    MaxEdge=number_slider_2)
int = Integer(graft(series))
createhbsrfs = Honeybee_createHBSrfs(geometry=separatebynormal.lookingUp, srfType=Slider(1, range=0..1), EPConstruction="SIA380_EXPOSED")  # -> readMe, simplify(HBSurface); plug-in component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
repeat = RepeatData(Data="bldg", Length=lng)  # -> graft(Data)
epconstruction = Honeybee_EnergyPlusConstruction(name="Swiss_exposed", layer_1=epopaquemat_2, layer_2=epopaquemat_3)  # -> EPConstruction; plug-in component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
createhbsrfs_2 = Honeybee_createHBSrfs(geometry=separatebynormal.lookingDown, srfType=Slider(2, range=0..10), EPBC="Ground", EPConstruction="SIA380_GROUND")  # -> readMe, simplify(HBSurface); plug-in component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
createhbsrfs_3 = Honeybee_createHBSrfs(geometry=separatebynormal.lookingSide, srfType=Slider(0, range=0..100), EPConstruction="SIA380_EXPOSED")  # -> readMe, simplify(HBSurface); plug-in component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
epconstruction_2 = Honeybee_EnergyPlusConstruction(name=panel_3, layer_1=epopaquemat_3, layer_2=epopaquemat)  # -> EPConstruction; plug-in component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
join = TextJoin(Text=[repeat, int])  # -> simplify(flatten(Result))
brep_4 = Brep(brep_2)
toggle_3 = BooleanToggle(True)
path_mapper = PathMapper(createhbsrfs_3.HBSurface, source="{A;B}", target="{A}")
mesh = MeshBrep(Brep=brep_4, Settings=custom_mesh_settings)
# If you set Write toTrue, a file will be written.
# This file will be included in the simulation.
daily_occupation_ratios = Panel("""1
1
1
1
1
1
1
1
1
1
1
1
1
1
1
1
1
1
1
1
1
1
1
1""")
# If you set Write toTrue, a file will be written.
# This file will be included in the simulation.
weekly_occupancy_day_id = Panel("""0
0
0
0
0
0
0""")
# 3. Set Optional Parameters
# (horizon, terrain, shading, occupancy profiles)
horiziontal = Panel("""0
90
180
270
360""")
# If you set Write toTrue, a file will be written.
# This file will be included in the simulation.
vertical = Panel("""10
10
10
10
10""")
addtoeplibrary = Honeybee_AddToEnergyPlusLibrary(EPObject=[epconstruction, epconstruction_2], addToProjectLib=toggle_3, overwrite=toggle_3)  # -> readMe; plug-in component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
context = Brep([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])
jagged = SettingsSpeed()
createhbzones = Honeybee_createHBZones(
    name=simplify(graft(join)),
    HBSurfaces=[createhbsrfs.HBSurface, createhbsrfs_2.HBSurface, path_mapper],
    isConditioned=True)  # -> readMe, simplify(HBZone); plug-in component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
faceb = FaceBoundaries(Mesh=mesh)  # -> simplify(Boundaries)
terrain_mesh = Mesh(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)
name_2 = Text(name)
mesh_2 = MeshBrep(Brep=context, Settings=jagged)
path_3 = FilePath(path)
name_3 = Text(name)
path_4 = FilePath(path)
false = Boolean(False)
detailed_surfaces = Surface(faceb)
name_4 = Text(name)
path_5 = FilePath(path)
panel_4 = Panel(addtoeplibrary)
path_6 = FilePath(path)
name_5 = Text(name)
citysim_srf = Honeybee_CitySimSrf(S=mesh_2, R=Slider(0.2, range=0..1), path=path_3, name=name_2, Write=Toggle(False))  # -> out; plug-in component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
citysim_srf_2 = Honeybee_CitySimSrf(S=terrain_mesh, R=Slider(0.1, range=0..1), type="terrain", Dup=false, path=path_4, name=name_3, Write=Toggle(False))  # -> out; plug-in component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
citysim_horizon = Honeybee_CitySimHorizon(H=horiziontal, V=vertical, path=path_5, name=name_4, Write=Toggle(False))  # -> out; plug-in component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
citysim_schedules = Honeybee_CitySimSchedules(path=path_6, day=daily_occupation_ratios, name=name_5, Write=Toggle(False))  # -> out; plug-in component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
hbzones = Data(createhbzones.HBZone)

# ----
# 4. Run simulation using HB Zones
hbzones_2 = Data(hbzones)
windows_settings = Panel("""0.4
0.5
1.0
0.0""")
occupancy_settings = Panel("""5
0""")
hbzones_3 = Data(hbzones_2)
climate_file_2 = Text(climate_file)
name_6 = Text(name)
path_7 = FilePath(path)
solver = Text(solver_path)
citysim_runsimulation = Honeybee_CitySimRunSimulation(
    HBZones=flatten(hbzones_3),
    Windows=windows_settings,
    Occupancy=occupancy_settings,
    path=path_7,
    name=name_6,
    climatefile=climate_file_2,
    Solver=solver,
    Write=Toggle(False),
    Run=Toggle(False))  # -> out; plug-in component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

# ----
# 5. Load results
toggle_4 = BooleanToggle(False)
name_7 = Text(name)
path_8 = FilePath(path)
hbzones_4 = Data(hbzones_2)
citysim_loadresults = Honeybee_CitySimLoadResults(path=path_8, name=name_7, yearly=toggle_4, HBZones=flatten(hbzones_4), Run=Toggle(True))  # -> SW, H, C, Geometry; plug-in component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

hourly_values = Data(citysim_loadresults.SW)
crv = Curve(citysim_loadresults.Geometry)

# ----
# 6. Create a solar radiation map
crv_2 = Curve(crv)
hourly_values_2 = Data(hourly_values)
srf = Surface(crv_2)
ma = MassAddition(Input=hourly_values_2)  # -> Result, PartialResults
division = Division(A=ma.Result, B=1000)
bnd = Bounds(Numbers=flatten(division))
dedomain = DeconstructDomain(Domain=bnd)  # -> Start, End
gradient = Gradient(
    LowerLimit=Slider(0, range=0..100),
    UpperLimit=dedomain.End,
    Parameter=division,
    stops=[0: RGB(0, 0, 255), 0.501: RGB(255, 255, 0), 1: RGB(255, 0, 0)])
preview = CustomPreview(Geometry=srf, Shader=gradient)

# ----
# 4b. Run simulation using geometry only
# This workflow does not rely on Honeybee zones.
# It is intended for solar calculations on detailed meshed, for which it is faster than the workflow based on HB.
crv_3 = Curve(detailed_surfaces)
name_8 = Text(name)
name_9 = Text(name_8)
climate_file_3 = Text(climate_file)
solver_2 = Text(solver_path)
path_9 = FilePath(path)
name_10 = Text(name_9)
crv_4 = Curve(crv_3)

# ---- group: set solar reflectance for each surface
crv_5 = Curve(crv_3)
lng_2 = ListLength(List=flatten(crv_5))
dup = DuplicateData(Data=Slider(0.2, range=0..1), Number=lng_2, Order=True)
unflatten = UnflattenTree(Tree=dup, Guide=crv_5)
reflectance = Data(unflatten)

# ----
reflectance_2 = Data(reflectance)
citysim_solar = Honeybee_CitySimSolar(
    geometry=crv_4,
    reflectance=reflectance_2,
    path=path_9,
    name=name_10,
    climatefile=climate_file_3,
    Solver=solver_2,
    Write=Toggle(False),
    Run=Toggle(False))  # -> out; plug-in component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

# ----
# 5b. Load results (SW only)
toggle_5 = BooleanToggle(False)
name_11 = Text(name_9)
path_10 = FilePath(path)
crv_6 = Curve(crv_3)
citysim_loadsolar = Honeybee_CitySimLoadSolar(path=path_10, name=name_11, geometry=crv_6, Run=toggle_5)  # -> results; plug-in component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
crv_7 = Curve(graft(crv_6))
ma_2 = MassAddition(Input=citysim_loadsolar)  # -> Result, PartialResults
